# Grasshopper definition Flowing Cities.gh (Grasshopper 1.0.7)

number_slider = Slider(7, range=0..100)  # disabled
number_slider_2 = Slider(7, range=0..100)  # disabled
box = CenterBox(Base=PlaneXY(0, 0, 0), X=number_slider, Y=number_slider, Z=number_slider)  # disabled
pt = Point([Point(-2.884844584, 2.153879053, 3.594346557), Point(2.981599895, 8.408290099, -2.821508857), Point(13.1312816, -0.2517753085, -0.2437687187), Point(5.056390435, 6.232571075, 6.608695788), Point(0.3321291635, 3.81001968, 5.996186582), Point(-5.571094306, 10.6000979, -6.884847532)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])  # disabled
pop3d = Populate3D(Region=box, Count=number_slider_2, Seed=1)  # disabled

increase_attraction = Slider(6, range=0..10)
window_coef = Slider(0.7, range=0..1)
windowcoefficient = GetNumber(window_coef, AtLeast=1, AtMost=1, Maximum=1.797693135e+308, Minimum=-1.797693135e+308)
windowwidthratio = GetInteger(Slider(6, range=0..10), AtLeast=1, AtMost=1, Maximum=2147483647, Minimum=-2147483648)
windowheightratio = GetInteger(Slider(7, range=0..10), AtLeast=1, AtMost=1, Maximum=2147483647, Minimum=-2147483648)
increaseattraction = GetInteger(increase_attraction, AtLeast=1, AtMost=1, Maximum=2147483647, Minimum=-2147483648)

pt_2 = Point([Point(-1.430751206, 5.057449234, 6.430423968), Point(0.5626866504, -2.383137915, 12.58096639), Point(6.999548794, 2.34460801, 11.80604369), Point(-2.045322258, -2.532989048, 5.447216653), Point(4.950790834, -1.413063211, 4.284855596), Point(10.66568, -5.669175024, 9.762899295), Point(1.5172561, -9.706618694, 4.262859638)])
get_point = GetPoint(pt_2, AtLeast=1, AtMost=1, Realtime=True)

pgroups = PointGroups(Points=get_point, Distance=Slider(4, range=0..10))  # -> Groups, Indices
lng = ListLength(List=pgroups.Groups)  # -> simplify(Length)
avr = Average(Input=pgroups.Groups)
equals = Equality(FirstNumber=lng, SecondNumber="1")  # -> Equality, Inequality
dispatch = Dispatch(List=avr, DispatchPattern=equals.Equality)  # -> ListA, ListB
lng_2 = ListLength(List=pgroups.Groups)
number_slider_3 = Slider(1, range=0..1)
multiplication = Multiplication(A=Slider(1, range=0..1), B=lng_2)
box_2 = CenterBox(Base=dispatch.ListA, X=number_slider_3, Y=number_slider_3, Z=Slider(2, range=0..10))
box_3 = CenterBox(Base=dispatch.ListB, X=multiplication, Y=multiplication, Z=Slider(2, range=0..10))
merge = Merge(Data1=box_2, Data2=box_3)

debrep = DeconstructBrep(Brep=merge)  # -> reparameterize(simplify(Faces)), Edges, Vertices

panel = Panel("""0
1
2
3""")
item = ListItem(List=debrep.Faces, Index=panel, Wrap=True)
divide = DivideDomain²(Domain=simplify(item), UCount=windowwidthratio, VCount=windowheightratio)
subsrf = Isotrim(Surface=reparameterize(simplify(graft(item))), Domain=divide)  # -> simplify(Surface)
debrep_2 = DeconstructBrep(Brep=subsrf)  # -> flatten(Faces), Edges, Vertices
lng_3 = ListLength(List=debrep_2.Faces)
multiplication_2 = Multiplication(A=lng_3, B=windowcoefficient)
reduce = RandomReduce(List=debrep_2.Faces, Reduction=multiplication_2, Seed=1)
area = Area(Geometry=reduce)  # -> Area, Centroid
scale = Scale(Geometry=reduce, Center=area.Centroid, Factor=Slider(0.8, range=0..1))  # -> Geometry, Transform
vec = Vector(scale.Geometry)
amp = Amplitude(Vector=vec, Amplitude=Slider(0.01, range=0..0.01))
move = Move(Geometry=scale.Geometry, Motion=amp)  # -> Geometry, Transform

item_2 = ListItem(List=debrep.Faces, Index="4", Wrap=True)
area_2 = Area(Geometry=item_2)  # -> Area, Centroid
pgroups_2 = PointGroups(Points=flatten(area_2.Centroid), Distance=increaseattraction)  # -> Groups, Indices
lng_4 = ListLength(List=pgroups_2.Groups)  # -> simplify(Length)
avr_2 = Average(Input=pgroups_2.Groups)
equals_2 = Equality(FirstNumber=lng_4, SecondNumber="1")  # -> Equality, Inequality
dispatch_2 = Dispatch(List=avr_2, DispatchPattern=equals_2.Equality)  # -> ListA, ListB
lng_5 = ListLength(List=pgroups_2.Groups)
number_slider_4 = Slider(0.1, range=0..1)
number_slider_5 = Slider(2.5, range=0..10)
multiplication_3 = Multiplication(A=number_slider_5, B=lng_5)
multiplication_4 = Multiplication(A=number_slider_4, B=lng_5)
box_4 = CenterBox(Base=area_2.Centroid, X=number_slider_5, Y=number_slider_5, Z=number_slider_4)
box_5 = CenterBox(Base=dispatch_2.ListB, X=multiplication_3, Y=multiplication_3, Z=multiplication_4)
merge_2 = Merge(Data1=box_4, Data2=box_5)

preview = CustomPreview(Geometry=merge, Material=ColourSwatch(SwatchColor=RGB(219, 199, 181)))
preview_2 = CustomPreview(Geometry=merge_2, Material=ColourSwatch(SwatchColor=RGB(100, 164, 58)))
preview_3 = CustomPreview(Geometry=move.Geometry, Material=ColourSwatch(SwatchColor=RGB(23, 187, 181)))

# ---- group: RH_OUT:Ground
mesh = Mesh(merge_2)

# ---- group: RH_OUT:Windows
mesh_2 = Mesh(move.Geometry)

# ---- group: RH_OUT:Buildings
mesh_3 = Mesh(merge)
